# Grasshopper definition Assembly drawing thesis.gh (Grasshopper 1.0.8)
# plug-ins: Heteroptera, Grasshopper-Tekla Link 2025.1.20, Grasshopper-Tekla drawing Link 2.23, Bifocals, MetaHopper, Telepathy, Sheepdog

# ----
# This Grasshopper script was developed by Edgar Krõzanovski.
user_interaction = Fence(
    Linetype="Continuous",
    NameHorizontal="Left",
    NamePlacement="Outside",
    NameSize=30,
    NameVertical="Top",
    Pattern="[0,0,0,0]",
    Width=14)

assembly_drawing = Fence(
    Linetype="Continuous",
    NameHorizontal="Left",
    NamePlacement="Outside",
    NameSize=30,
    NameVertical="Top",
    Pattern="[0,0,0,0]",
    Width=14)

# ----
# 1/5
# 2/5
# 3/5
# 4/5
# 5/5
top_view = Fence(
    Linetype="Continuous",
    NameHorizontal="Left",
    NamePlacement="Outside",
    NameSize=30,
    NameVertical="Top",
    Pattern="[0,0,0,0]",
    Width=14)

# ----
# 1/5
# 2/5
# 3/5
# 4/5
# 5/5
section_view = Fence(
    Linetype="Continuous",
    NameHorizontal="Left",
    NamePlacement="Outside",
    NameSize=30,
    NameVertical="Top",
    Pattern="[0,0,0,0]",
    Width=14)

# ----
# 1/5
# 2/5
# 3/5
# 4/5
# 5/5
bottom_view = Fence(
    Linetype="Continuous",
    NameHorizontal="Left",
    NamePlacement="Outside",
    NameSize=30,
    NameVertical="Top",
    Pattern="[0,0,0,0]",
    Width=14)

# ----
# 3d View Attributes
panel = Panel("assembly_3D_view")
_3d_view_attributes = RemoteSender(panel)

# ----
# Assembly View Attributes
panel_2 = Panel("a_standard_without_dimension")
part_view_attributes = RemoteSender(panel_2)

# ----
# Assembly Drawing Attributes
panel_3 = Panel("standard")
assembly_drawing_attributes = RemoteSender(panel_3)

# ----
# Mark Attributes
# 1.
panel_4 = Panel("standard")
mark_attributes = MarkAttributes(AttributesName=panel_4)
mark_attributes_2 = RemoteSender(mark_attributes)

# ----
# Dimension Line Attributes
panel_5 = Panel("standard")
dimension_line_attributes = DimensionLineAttributes(AttributesName=panel_5)
bottom_view_dimension_line_attributes = RemoteSender(dimension_line_attributes)
section_view_dimension_line_attributes = RemoteSender(dimension_line_attributes)
front_view_dimension_line_attributes = RemoteSender(dimension_line_attributes)
top_view_dimension_line_attributes = RemoteSender(dimension_line_attributes)

# ----
# Select Steel Column Assembly located on the grid B3 in Tekla Structures.
# 2.
# Create Assembly drawing by triggering the Toggle.
create_assembly_drawing = BooleanToggle(True)
remote_sender = RemoteSender(create_assembly_drawing)

# ----
# Create drawing
remote_receiver = RemoteReceiver(remote_sender)
assembly_drawing_attributes_2 = RemoteReceiver(assembly_drawing_attributes)
selected_model_objects = SelectedModelObjects(Toggle=remote_receiver)
create_a_drawing = CreateADrawing(Assembly=selected_model_objects, AttributesName=assembly_drawing_attributes_2, SheetNumber="1")
open_drawing = OpenDrawing(Drawing=create_a_drawing, Show=True)

# ----
# Move the existing view outside from the drawing
remote_receiver_2 = RemoteReceiver(remote_sender)
active_drawing = ActiveDrawing(Toggle=remote_receiver_2)
drawing_size = DrawingSize(Drawing=active_drawing)  # -> Width, Height, Rectangle
unit_x = UnitX(Factor=drawing_size.Width)
views_in_drawing = ViewsInDrawing(Drawing=active_drawing, All_objects=0)
negative = Negative(Value=unit_x)
move_view = MoveView(View=views_in_drawing, Vector=negative)

# ----
# 3.
# Create new views by triggering the Toggle.
create_new_views = BooleanToggle(True)
remote_sender_2 = RemoteSender(create_new_views)

# ----
# Active Drawing
remote_receiver_3 = RemoteReceiver(remote_sender_2)
active_drawing_2 = ActiveDrawing(Toggle=remote_receiver_3)
active_drawing_3 = RemoteSender(active_drawing_2)

# ----
# Center of Drawing
active_drawing_4 = RemoteReceiver(active_drawing_3)
drawing_size_2 = DrawingSize(Drawing=active_drawing_4)  # -> Width, Height, Rectangle
geometry = Geometry(drawing_size_2.Rectangle)
center = Center(Geometry=geometry)  # -> Center, Dimension
point = Point(center.Center)
center_of_drawing = RemoteSender(point)

# ----
# 4.
# Adjust the drawing scale. Type number to the panel.
panel_6 = Panel("6")
drawing_scale = RemoteSender(panel_6)

# ----
# Create Front View
drawing_scale_2 = RemoteReceiver(drawing_scale)
active_drawing_5 = RemoteReceiver(active_drawing_3)
center_of_drawing_2 = RemoteReceiver(center_of_drawing)
part_view_attributes_2 = RemoteReceiver(part_view_attributes)
part_view_types = PartViewTypes({"Front": "FrontView", "Top": "TopView", "Back": "BackView", "Bottom": "BottomView", "3d": "_3DView"}, selected="Front")
part_view = PartView(
    Drawing=active_drawing_5,
    Type=part_view_types,
    Point=center_of_drawing_2,
    Scale=drawing_scale_2,
    AttributesName=part_view_attributes_2,
    Name="Front",
    Attributes_by_macro=False,
    Remove_when_input_is_empty=False)
front_view = RemoteSender(part_view)

# ----
# Front View Display CS
front_view_2 = RemoteReceiver(front_view)
view_properties = ViewProperties(View=front_view_2)  # -> Type, Name, ViewCS, DisplayCS, RestrictionBox, Scale, Tags
front_view_display_cs = RemoteSender(view_properties.DisplayCS)

geometry_2 = Fence(
    Linetype="Continuous",
    NameHorizontal="Left",
    NamePlacement="Outside",
    NameSize=30,
    NameVertical="Top",
    Pattern="[0,0,0,0]",
    Width=14)

# ----
# Model Objects
active_drawing_6 = RemoteReceiver(active_drawing_3)
drawing_source = DrawingSource(Drawing=active_drawing_6)
deconstruct_assembly = DeconstructAssembly(Assembly=drawing_source, ToleranceMm=0.6)  # -> Name, Type, MainPart, Secondaries, AllObjects
secondaries = RemoteSender(deconstruct_assembly.Secondaries)
main_part = RemoteSender(deconstruct_assembly.MainPart)

# ----
# Main and Secondary Brep
main_part_2 = RemoteReceiver(main_part)
secondaries_2 = RemoteReceiver(secondaries)
convert_to_brep = ConvertToBrep(TeklaObject=main_part_2, SolidType=2, ToleranceMm=0.6)
convert_to_brep_2 = ConvertToBrep(TeklaObject=secondaries_2, SolidType=2, ToleranceMm=0.6)
secondary_part_brep = RemoteSender(convert_to_brep_2)
main_part_brep = RemoteSender(convert_to_brep)

# ----
# 5.
# Adjust location of the dimensions and views.
# Front View
front_view_direction_1 = ViewingDirection({"From Bottom": {0,1,0}, "From Top": {0,-1,0}}, selected="From Top")
front_view_direction_2 = ViewingDirection({"From Left": {1,0,0}, "From Right": {-1,0,0}}, selected="From Right")
front_view_dimension_offset = Slider(100, range=20..200)
front_view_dimension_offset_2 = Slider(50, range=0..100)
front_view_dimension_offset_3 = Slider(50, range=0..100)
front_view_dimension_offset_2_2 = RemoteSender(front_view_dimension_offset_2)
front_view_dimension_offset_3_2 = RemoteSender(front_view_dimension_offset_3)
front_view_dimension_offset_4 = RemoteSender(front_view_dimension_offset)
front_view_direction_1_2 = RemoteSender(front_view_direction_1)
front_view_direction_2_2 = RemoteSender(front_view_direction_2)

# ----
# 2/5
# 1/5
# 3/5
# 4/5
# 5/5
front_view_3 = Fence(
    Linetype="Continuous",
    NameHorizontal="Left",
    NamePlacement="Outside",
    NameSize=30,
    NameVertical="Top",
    Pattern="[0,0,0,0]",
    Width=14)
front_view_dimension_offset_2_3 = RemoteReceiver(front_view_dimension_offset_2_2)

# ----
# Top View
top_view_direction_1 = ViewingDirection({"From Bottom": {0,1,0}, "From Top": {0,-1,0}}, selected="From Top")
top_view_direction_2 = ViewingDirection({"From Left": {1,0,0}, "From Right": {-1,0,0}}, selected="From Right")
top_view_dimension_offset = Slider(50, range=20..200)
top_view_offset_y = Slider(86, range=50..100)
top_view_dimension_offset_2 = RemoteSender(top_view_dimension_offset)
top_view_direction_1_2 = RemoteSender(top_view_direction_1)
top_view_direction_2_2 = RemoteSender(top_view_direction_2)
top_view_offset_y_2 = RemoteSender(top_view_offset_y)

# ----
# Top View Offset
top_view_offset_x = Slider(0, range=-10..10)
front_view_4 = RemoteReceiver(front_view)
top_view_offset_y_3 = RemoteReceiver(top_view_offset_y_2)
view_frame_geometry = ViewFrameGeometry(View=front_view_4)  # -> UpperLeft, UpperRight, LowerLeft, LowerRight, Rectangle, Width, Height, Origin
line = Line(StartPoint=view_frame_geometry.UpperLeft, EndPoint=view_frame_geometry.UpperRight)
unit_y = UnitY(Factor=top_view_offset_y_3)
unit_x_2 = UnitX(Factor=top_view_offset_x)
curve_middle = CurveMiddle(Curve=line)
move = Move(Geometry=curve_middle, Motion=unit_y)  # -> Geometry, Transform
move_2 = Move(Geometry=move.Geometry, Motion=unit_x_2)  # -> Geometry, Transform
top_view_offset = RemoteSender(move_2.Geometry)

# ----
# Create Top View
drawing_scale_3 = RemoteReceiver(drawing_scale)
active_drawing_7 = RemoteReceiver(active_drawing_3)
top_view_offset_2 = RemoteReceiver(top_view_offset)
part_view_attributes_3 = RemoteReceiver(part_view_attributes)
part_view_types_2 = PartViewTypes({"Front": "FrontView", "Top": "TopView", "Back": "BackView", "Bottom": "BottomView", "3d": "_3DView"}, selected="Top")
part_view_2 = PartView(
    Drawing=active_drawing_7,
    Type=part_view_types_2,
    Point=top_view_offset_2,
    Scale=drawing_scale_3,
    AttributesName=part_view_attributes_3,
    Name="Top",
    Attributes_by_macro=False,
    Remove_when_input_is_empty=False)
top_view_2 = RemoteSender(part_view_2)

# ----
# Top View Display CS
top_view_3 = RemoteReceiver(top_view_2)
view_properties_2 = ViewProperties(View=top_view_3)  # -> Type, Name, ViewCS, DisplayCS, RestrictionBox, Scale, Tags
top_view_display_cs = RemoteSender(view_properties_2.DisplayCS)

# ----
# Bottom View
bottom_view_direction_1 = ViewingDirection({"From Bottom": {0,1,0}, "From Top": {0,-1,0}}, selected="From Top")
bottom_view_direction_2 = ViewingDirection({"From Left": {1,0,0}, "From Right": {-1,0,0}}, selected="From Right")
bottom_view_dimension_offset = Slider(50, range=20..200)
bottom_view_offset_y = Slider(87, range=50..100)
bottom_view_dimension_offset_2 = RemoteSender(bottom_view_dimension_offset)
bottom_view_direction_1_2 = RemoteSender(bottom_view_direction_1)
bottom_view_direction_2_2 = RemoteSender(bottom_view_direction_2)
bottom_view_offset_y_2 = RemoteSender(bottom_view_offset_y)

# ----
# Bottom View Offset
bottom_view_offset_x = Slider(0, range=-10..10)
front_view_5 = RemoteReceiver(front_view)
bottom_view_offset_y_3 = RemoteReceiver(bottom_view_offset_y_2)
negative_2 = Negative(Value=bottom_view_offset_y_3)
view_frame_geometry_2 = ViewFrameGeometry(View=front_view_5)  # -> UpperLeft, UpperRight, LowerLeft, LowerRight, Rectangle, Width, Height, Origin
unit_y_2 = UnitY(Factor=negative_2)
unit_x_3 = UnitX(Factor=bottom_view_offset_x)
line_2 = Line(StartPoint=view_frame_geometry_2.LowerLeft, EndPoint=view_frame_geometry_2.LowerRight)
curve_middle_2 = CurveMiddle(Curve=line_2)
move_3 = Move(Geometry=curve_middle_2, Motion=unit_y_2)  # -> Geometry, Transform
move_4 = Move(Geometry=move_3.Geometry, Motion=unit_x_3)  # -> Geometry, Transform
bottom_view_offset = RemoteSender(move_4.Geometry)

# ----
# Create Bottom View
drawing_scale_4 = RemoteReceiver(drawing_scale)
active_drawing_8 = RemoteReceiver(active_drawing_3)
bottom_view_offset_2 = RemoteReceiver(bottom_view_offset)
part_view_attributes_4 = RemoteReceiver(part_view_attributes)
part_view_types_3 = PartViewTypes({"Front": "FrontView", "Top": "TopView", "Back": "BackView", "Bottom": "BottomView", "3d": "_3DView"}, selected="Bottom")
part_view_3 = PartView(
    Drawing=active_drawing_8,
    Type=part_view_types_3,
    Point=bottom_view_offset_2,
    Scale=drawing_scale_4,
    AttributesName=part_view_attributes_4,
    Name="Bottom",
    Attributes_by_macro=False,
    Remove_when_input_is_empty=False)
bottom_view_2 = RemoteSender(part_view_3)

# ----
# Bottom View Display CS
bottom_view_3 = RemoteReceiver(bottom_view_2)
view_properties_3 = ViewProperties(View=bottom_view_3)  # -> Type, Name, ViewCS, DisplayCS, RestrictionBox, Scale, Tags
bottom_view_display_cs = RemoteSender(view_properties_3.DisplayCS)

# ----
# Section View
section_view_direction_1 = ViewingDirection({"From Bottom": {0,1,0}, "From Top": {0,-1,0}}, selected="From Bottom")
section_view_direction_2 = ViewingDirection({"From Left": {1,0,0}, "From Right": {-1,0,0}}, selected="From Right")
section_view_dimension_offset = Slider(58, range=20..200)
section_view_dimension_offset_2 = Slider(63, range=0..100)
section_view_offset_x = Slider(109, range=50..150)
section_view_dimension_offset_2_2 = RemoteSender(section_view_dimension_offset_2)
section_view_dimension_offset_3 = RemoteSender(section_view_dimension_offset)
section_view_direction_1_2 = RemoteSender(section_view_direction_1)
section_view_direction_2_2 = RemoteSender(section_view_direction_2)
section_view_offset_x_2 = RemoteSender(section_view_offset_x)

# ----
# Section View Offset
front_view_6 = RemoteReceiver(front_view)
section_view_offset_x_3 = RemoteReceiver(section_view_offset_x_2)
negative_3 = Negative(Value=section_view_offset_x_3)
view_frame_geometry_3 = ViewFrameGeometry(View=front_view_6)  # -> UpperLeft, UpperRight, LowerLeft, LowerRight, Rectangle, Width, Height, Origin
unit_x_4 = UnitX(Factor=negative_3)
line_3 = Line(StartPoint=view_frame_geometry_3.UpperLeft, EndPoint=view_frame_geometry_3.LowerLeft)
curve_middle_3 = CurveMiddle(Curve=line_3)
move_5 = Move(Geometry=curve_middle_3, Motion=unit_x_4)  # -> Geometry, Transform
section_view_offset = RemoteSender(move_5.Geometry)

# ----
# 3d View
_3d_view_offset_x = Slider(105, range=50..150)
_3d_view_offset_x_2 = RemoteSender(_3d_view_offset_x)

# ----
# Front View Union Boxes
main_part_brep_2 = RemoteReceiver(main_part_brep)
secondary_part_brep_2 = RemoteReceiver(secondary_part_brep)
front_view_display_cs_2 = RemoteReceiver(front_view_display_cs)
front_view_display_cs_3 = RemoteReceiver(front_view_display_cs)
simple_orient = SimpleOrient(Geometry=main_part_brep_2, Plane=front_view_display_cs_2)
simple_orient_2 = SimpleOrient(Geometry=secondary_part_brep_2, Plane=front_view_display_cs_3)
brep_projection_border = BrepProjectionBorder(Brep=simple_orient)  # -> Boundary, Hole, UnionRectangle
brep_projection_border_2 = BrepProjectionBorder(Brep=simple_orient_2)  # -> Boundary, Hole, UnionRectangle
bounding_box = BoundingBox(
    Content=flatten([brep_projection_border.UnionRectangle, brep_projection_border_2.UnionRectangle]),
    Plane=PlaneXY(0, 0, 0),
    UnionBox=True)  # -> Box, Box_2
brep_projection_border_3 = BrepProjectionBorder(Brep=bounding_box.Box)  # -> Boundary, Hole, UnionRectangle
front_view_secondary_part_union_box = RemoteSender(brep_projection_border_2.UnionRectangle)
front_view_main_part_union_box = RemoteSender(brep_projection_border.UnionRectangle)
front_view_union_box = RemoteSender(brep_projection_border_3.UnionRectangle)

# ----
# Section View Points
front_view_union_box_2 = RemoteReceiver(front_view_union_box)
unit_x_5 = UnitX(Factor=1)
find_visible_edges = FindVisibleEdges(Curve=front_view_union_box_2, Vector=unit_x_5)  # -> Points, Edges, Extremes
end_points = EndPoints(Curve=find_visible_edges.Edges)  # -> Start, End
deconstruct = Deconstruct(Point=end_points.Start)  # -> XComponent, YComponent, ZComponent
deconstruct_2 = Deconstruct(Point=end_points.End)  # -> XComponent, YComponent, ZComponent
addition = Addition(A="-100", B=deconstruct.XComponent)
addition_2 = Addition(A="-100", B=deconstruct_2.XComponent)
construct_point = ConstructPoint(XCoordinate=addition, YCoordinate=deconstruct.YComponent, ZCoordinate=deconstruct.ZComponent)
construct_point_2 = ConstructPoint(XCoordinate=addition_2, YCoordinate=deconstruct_2.YComponent, ZCoordinate=deconstruct_2.ZComponent)
section_view_start_point = RemoteSender(construct_point)
section_view_end_point = RemoteSender(construct_point_2)

# ----
# Create Section View
front_view_7 = RemoteReceiver(front_view)
drawing_scale_5 = RemoteReceiver(drawing_scale)
section_view_offset_2 = RemoteReceiver(section_view_offset)
part_view_attributes_5 = RemoteReceiver(part_view_attributes)
section_view_end_point_2 = RemoteReceiver(section_view_end_point)
section_view_start_point_2 = RemoteReceiver(section_view_start_point)
section_view_2 = SectionView(
    View=front_view_7,
    StartPoint=section_view_start_point_2,
    EndPoint=section_view_end_point_2,
    InsertionPoint=section_view_offset_2,
    ViewAttributes=part_view_attributes_5,
    Scale=drawing_scale_5,
    Attributes_by_macro=False,
    Remove_when_input_is_empty=False)  # -> View, Mark
section_view_3 = RemoteSender(section_view_2.View)

# ----
# Section View Display CS
section_view_4 = RemoteReceiver(section_view_3)
view_properties_4 = ViewProperties(View=section_view_4)  # -> Type, Name, ViewCS, DisplayCS, RestrictionBox, Scale, Tags
section_view_display_cs = RemoteSender(view_properties_4.DisplayCS)

# ----
# Top View Union Boxes
main_part_brep_3 = RemoteReceiver(main_part_brep)
top_view_display_cs_2 = RemoteReceiver(top_view_display_cs)
top_view_display_cs_3 = RemoteReceiver(top_view_display_cs)
secondary_part_brep_3 = RemoteReceiver(secondary_part_brep)
simple_orient_3 = SimpleOrient(Geometry=secondary_part_brep_3, Plane=top_view_display_cs_3)
simple_orient_4 = SimpleOrient(Geometry=main_part_brep_3, Plane=top_view_display_cs_2)
brep_projection_border_4 = BrepProjectionBorder(Brep=simple_orient_4)  # -> Boundary, Hole, UnionRectangle
brep_projection_border_5 = BrepProjectionBorder(Brep=simple_orient_3)  # -> Boundary, Hole, UnionRectangle
bounding_box_2 = BoundingBox(
    Content=flatten([brep_projection_border_4.UnionRectangle, brep_projection_border_5.UnionRectangle]),
    Plane=PlaneXY(0, 0, 0),
    UnionBox=True)  # -> Box, Box_2
brep_projection_border_6 = BrepProjectionBorder(Brep=bounding_box_2.Box)  # -> Boundary, Hole, UnionRectangle
top_view_secondary_part_union_box = RemoteSender(brep_projection_border_5.UnionRectangle)
top_view_main_part_union_box = RemoteSender(brep_projection_border_4.UnionRectangle)
top_view_union_box = RemoteSender(brep_projection_border_6.UnionRectangle)

# ----
# Bottom View Union Boxes
main_part_brep_4 = RemoteReceiver(main_part_brep)
secondary_part_brep_4 = RemoteReceiver(secondary_part_brep)
bottom_view_display_cs_2 = RemoteReceiver(bottom_view_display_cs)
bottom_view_display_cs_3 = RemoteReceiver(bottom_view_display_cs)
simple_orient_5 = SimpleOrient(Geometry=main_part_brep_4, Plane=bottom_view_display_cs_2)
simple_orient_6 = SimpleOrient(Geometry=secondary_part_brep_4, Plane=bottom_view_display_cs_3)
brep_projection_border_7 = BrepProjectionBorder(Brep=simple_orient_5)  # -> Boundary, Hole, UnionRectangle
brep_projection_border_8 = BrepProjectionBorder(Brep=simple_orient_6)  # -> Boundary, Hole, UnionRectangle
bounding_box_3 = BoundingBox(
    Content=flatten([brep_projection_border_7.UnionRectangle, brep_projection_border_8.UnionRectangle]),
    Plane=PlaneXY(0, 0, 0),
    UnionBox=True)  # -> Box, Box_2
brep_projection_border_9 = BrepProjectionBorder(Brep=bounding_box_3.Box)  # -> Boundary, Hole, UnionRectangle
bottom_view_secondary_part_union_box = RemoteSender(brep_projection_border_8.UnionRectangle)
bottom_view_main_part_union_box = RemoteSender(brep_projection_border_7.UnionRectangle)
bottom_view_union_box = RemoteSender(brep_projection_border_9.UnionRectangle)

# ----
# Secondary Part Bolt Array
secondaries_3 = RemoteReceiver(secondaries)
get_children = GetChildren(TeklaObject=secondaries_3, ToleranceMm=0.6)
search_using_key = SearchUsingKey(Values=get_children, Keys=get_children, Search="Bolt Array")
secondary_part_bolt_array = RemoteSender(search_using_key)

# ----
# Main Part Bolt Array
main_part_3 = RemoteReceiver(main_part)
get_children_2 = GetChildren(TeklaObject=main_part_3, ToleranceMm=0.6)
search_using_key_2 = SearchUsingKey(Values=get_children_2, Keys=get_children_2, Search="Bolt Array")
main_part_bolt_array = RemoteSender(search_using_key_2)

# ----
# Front View Drawing Objects For Marks
main_part_4 = RemoteReceiver(main_part)
front_view_8 = RemoteReceiver(front_view)
front_view_9 = RemoteReceiver(front_view)
main_part_bolt_array_2 = RemoteReceiver(main_part_bolt_array)
graft_tree = GraftTree(Tree=main_part_bolt_array_2, IncludeEmptyLists=True, IncludeNullItems=True)
explode_tree = ExplodeTree(Data=graft_tree)  # -> Branch0, Branch1, Branch2
model_to_drawing_object = ModelToDrawingObject(ViewBase=front_view_8, ModelObject=explode_tree.Branch2)
model_to_drawing_object_2 = ModelToDrawingObject(ViewBase=front_view_9, ModelObject=main_part_4)
merge = Merge(Data1=model_to_drawing_object, Data2=model_to_drawing_object_2)
front_view_drawing_objects = RemoteSender(merge)

# ----
# Front View Bolt Points
main_part_bolt_array_3 = RemoteReceiver(main_part_bolt_array)
front_view_display_cs_4 = RemoteReceiver(front_view_display_cs)
bolt_properties = BoltProperties(Bolt=main_part_bolt_array_3)  # -> Size, Standard, Type, Positions, Direction
explode_tree_2 = ExplodeTree(Data=bolt_properties.Positions)  # -> Branch0, Branch1, Branch2
simple_orient_7 = SimpleOrient(Geometry=explode_tree_2.Branch2, Plane=front_view_display_cs_4)
front_view_bolt_points = RemoteSender(simple_orient_7)

# ----
# Top View Drawing Objects For Marks
top_view_4 = RemoteReceiver(top_view_2)
main_part_bolt_array_4 = RemoteReceiver(main_part_bolt_array)
graft_tree_2 = GraftTree(Tree=main_part_bolt_array_4, IncludeEmptyLists=True, IncludeNullItems=True)
explode_tree_3 = ExplodeTree(Data=graft_tree_2)  # -> Branch0, Branch1, Branch2
model_to_drawing_object_3 = ModelToDrawingObject(ViewBase=top_view_4, ModelObject=explode_tree_3.Branch0)
top_view_drawing_objects = RemoteSender(model_to_drawing_object_3)

# ----
# Bottom View Drawing Objects For Marks
bottom_view_4 = RemoteReceiver(bottom_view_2)
main_part_bolt_array_5 = RemoteReceiver(main_part_bolt_array)
graft_tree_3 = GraftTree(Tree=main_part_bolt_array_5, IncludeEmptyLists=True, IncludeNullItems=True)
explode_tree_4 = ExplodeTree(Data=graft_tree_3)  # -> Branch0, Branch1, Branch2
model_to_drawing_object_4 = ModelToDrawingObject(ViewBase=bottom_view_4, ModelObject=explode_tree_4.Branch1)
bottom_view_drawing_objects = RemoteSender(model_to_drawing_object_4)

# ----
# Top View Bolt Points
main_part_bolt_array_6 = RemoteReceiver(main_part_bolt_array)
top_view_display_cs_4 = RemoteReceiver(top_view_display_cs)
bolt_properties_2 = BoltProperties(Bolt=main_part_bolt_array_6)  # -> Size, Standard, Type, Positions, Direction
explode_tree_5 = ExplodeTree(Data=bolt_properties_2.Positions)  # -> Branch0, Branch1, Branch2
simple_orient_8 = SimpleOrient(Geometry=explode_tree_5.Branch0, Plane=top_view_display_cs_4)
top_view_bolt_points = RemoteSender(simple_orient_8)

# ----
# Bottom View Bolt Points
main_part_bolt_array_7 = RemoteReceiver(main_part_bolt_array)
bottom_view_display_cs_4 = RemoteReceiver(bottom_view_display_cs)
bolt_properties_3 = BoltProperties(Bolt=main_part_bolt_array_7)  # -> Size, Standard, Type, Positions, Direction
explode_tree_6 = ExplodeTree(Data=bolt_properties_3.Positions)  # -> Branch0, Branch1, Branch2
simple_orient_9 = SimpleOrient(Geometry=explode_tree_6.Branch1, Plane=bottom_view_display_cs_4)
bottom_view_bolt_points = RemoteSender(simple_orient_9)

# ----
# Section View Drawing Objects For Marks
secondaries_4 = RemoteReceiver(secondaries)
section_view_5 = RemoteReceiver(section_view_3)
section_view_6 = RemoteReceiver(section_view_3)
secondary_part_bolt_array_2 = RemoteReceiver(secondary_part_bolt_array)
model_to_drawing_object_5 = ModelToDrawingObject(ViewBase=section_view_5, ModelObject=secondary_part_bolt_array_2)
model_to_drawing_object_6 = ModelToDrawingObject(ViewBase=section_view_6, ModelObject=secondaries_4)
merge_2 = Merge(Data1=model_to_drawing_object_5, Data2=model_to_drawing_object_6)
section_view_drawing_objects = RemoteSender(merge_2)

# ----
# Section View Union Boxes
main_part_brep_5 = RemoteReceiver(main_part_brep)
secondary_part_brep_5 = RemoteReceiver(secondary_part_brep)
section_view_display_cs_2 = RemoteReceiver(section_view_display_cs)
section_view_display_cs_3 = RemoteReceiver(section_view_display_cs)
simple_orient_10 = SimpleOrient(Geometry=secondary_part_brep_5, Plane=section_view_display_cs_3)
simple_orient_11 = SimpleOrient(Geometry=main_part_brep_5, Plane=section_view_display_cs_2)
brep_projection_border_10 = BrepProjectionBorder(Brep=simple_orient_11)  # -> Boundary, Hole, UnionRectangle
brep_projection_border_11 = BrepProjectionBorder(Brep=simple_orient_10)  # -> Boundary, Hole, UnionRectangle
bounding_box_4 = BoundingBox(
    Content=flatten([brep_projection_border_10.UnionRectangle, brep_projection_border_11.UnionRectangle]),
    Plane=PlaneXY(0, 0, 0),
    UnionBox=True)  # -> Box, Box_2
brep_projection_border_12 = BrepProjectionBorder(Brep=bounding_box_4.Box)  # -> Boundary, Hole, UnionRectangle
section_view_secondary_part_union_box = RemoteSender(brep_projection_border_11.UnionRectangle)
section_view_main_part_union_box = RemoteSender(brep_projection_border_10.UnionRectangle)
section_view_union_box = RemoteSender(brep_projection_border_12.UnionRectangle)

mark_attributes_3 = RemoteReceiver(mark_attributes_2)
# 6.
# Enable the whole marks group or one by one to create marks.
front_view_drawing_objects_2 = RemoteReceiver(front_view_drawing_objects)
mark = Mark(DrawingObject=front_view_drawing_objects_2, Attributes=mark_attributes_3, Remove_when_input_is_empty=False)

mark_attributes_4 = RemoteReceiver(mark_attributes_2)
top_view_drawing_objects_2 = RemoteReceiver(top_view_drawing_objects)
mark_2 = Mark(DrawingObject=top_view_drawing_objects_2, Attributes=mark_attributes_4, Remove_when_input_is_empty=False)

mark_attributes_5 = RemoteReceiver(mark_attributes_2)
bottom_view_drawing_objects_2 = RemoteReceiver(bottom_view_drawing_objects)
mark_3 = Mark(DrawingObject=bottom_view_drawing_objects_2, Attributes=mark_attributes_5, Remove_when_input_is_empty=False)

mark_attributes_6 = RemoteReceiver(mark_attributes_2)
section_view_drawing_objects_2 = RemoteReceiver(section_view_drawing_objects)
mark_4 = Mark(DrawingObject=section_view_drawing_objects_2, Attributes=mark_attributes_6, Remove_when_input_is_empty=False)

# ----
# Section View Bolt Points
section_view_display_cs_4 = RemoteReceiver(section_view_display_cs)
secondary_part_bolt_array_3 = RemoteReceiver(secondary_part_bolt_array)
bolt_properties_4 = BoltProperties(Bolt=secondary_part_bolt_array_3)  # -> Size, Standard, Type, Positions, Direction
simple_orient_12 = SimpleOrient(Geometry=bolt_properties_4.Positions, Plane=section_view_display_cs_4)
section_view_bolt_points = RemoteSender(simple_orient_12)

document_info = DocumentInfo(AutoUpdate=False, Recursive=False)  # -> DocumentName, DocumentFilePath, Components, Params, _3rdPartyAssemblies
_3d_view = Fence(
    Linetype="Continuous",
    NameHorizontal="Left",
    NamePlacement="Outside",
    NameSize=30,
    NameVertical="Top",
    Pattern="[0,0,0,0]",
    Width=14)

# ----
# 3d View Offset
front_view_10 = RemoteReceiver(front_view)
_3d_view_offset_x_3 = RemoteReceiver(_3d_view_offset_x_2)
view_frame_geometry_4 = ViewFrameGeometry(View=front_view_10)  # -> UpperLeft, UpperRight, LowerLeft, LowerRight, Rectangle, Width, Height, Origin
line_4 = Line(StartPoint=view_frame_geometry_4.UpperRight, EndPoint=view_frame_geometry_4.LowerRight)
unit_x_6 = UnitX(Factor=_3d_view_offset_x_3)
curve_middle_4 = CurveMiddle(Curve=line_4)
move_6 = Move(Geometry=curve_middle_4, Motion=unit_x_6)  # -> Geometry, Transform
_3d_view_offset = RemoteSender(move_6.Geometry)

# ----
# Create 3d View
drawing_scale_6 = RemoteReceiver(drawing_scale)
_3d_view_offset_2 = RemoteReceiver(_3d_view_offset)
active_drawing_9 = RemoteReceiver(active_drawing_3)
_3d_view_attributes_2 = RemoteReceiver(_3d_view_attributes)
part_view_types_4 = PartViewTypes({"Front": "FrontView", "Top": "TopView", "Back": "BackView", "Bottom": "BottomView", "3d": "_3DView"}, selected="3d")
multiplication = Multiplication(A=drawing_scale_6, B="3")
part_view_4 = PartView(
    Drawing=active_drawing_9,
    Type=part_view_types_4,
    Point=_3d_view_offset_2,
    Scale=multiplication,
    AttributesName=_3d_view_attributes_2,
    Name="3d",
    Attributes_by_macro=False,
    Remove_when_input_is_empty=False)
_3d_view_2 = RemoteSender(part_view_4)

# ----
# Front View Points Direction 2
front_view_direction_2_3 = RemoteReceiver(front_view_direction_2_2)
front_view_bolt_points_2 = RemoteReceiver(front_view_bolt_points)
front_view_direction_2_4 = RemoteReceiver(front_view_direction_2_2)
front_view_main_part_union_box_2 = RemoteReceiver(front_view_main_part_union_box)
sort_by_vector = SortByVector(Geometry=front_view_bolt_points_2, Vector=front_view_direction_2_4)  # -> Geometry, Indices
list_item = ListItem(List=sort_by_vector.Geometry, Index=0, Wrap=True)  # -> Item, Item1
find_visible_edges_2 = FindVisibleEdges(Curve=front_view_main_part_union_box_2, Vector=front_view_direction_2_3)  # -> Points, Edges, Extremes
merge_3 = Merge(Data1=find_visible_edges_2.Points, Data2=list_item.Item, Data3=list_item.Item1)  # -> flatten(Result)
front_view_points_direction_2_dimension = RemoteSender(find_visible_edges_2.Points)  # "Front View Points Direction 2 Dimension 2"
front_view_points_direction_2_dimension_2 = RemoteSender(merge_3)  # "Front View Points Direction 2 Dimension 1"

# ----
# Front View Points Direction 1
front_view_direction_1_3 = RemoteReceiver(front_view_direction_1_2)
front_view_direction_1_4 = RemoteReceiver(front_view_direction_1_2)
front_view_bolt_points_3 = RemoteReceiver(front_view_bolt_points)
front_view_direction_1_5 = RemoteReceiver(front_view_direction_1_2)
front_view_main_part_union_box_3 = RemoteReceiver(front_view_main_part_union_box)
front_view_secondary_part_union_box_2 = RemoteReceiver(front_view_secondary_part_union_box)
find_visible_edges_3 = FindVisibleEdges(Curve=front_view_main_part_union_box_3, Vector=front_view_direction_1_4)  # -> Points, Edges, Extremes
unit_x_7 = UnitX(Factor=1)
sort_by_vector_2 = SortByVector(Geometry=front_view_bolt_points_3, Vector=front_view_direction_1_5)  # -> Geometry, Indices
find_visible_edges_4 = FindVisibleEdges(Curve=front_view_secondary_part_union_box_2, Vector=front_view_direction_1_3)  # -> Points, Edges, Extremes
list_item_2 = ListItem(List=sort_by_vector_2.Geometry, Index=0, Wrap=True)  # -> Item, Item1, Item2
sort_by_vector_3 = SortByVector(Geometry=find_visible_edges_4.Points, Vector=unit_x_7)  # -> Geometry, Indices
unit_x_8 = UnitX(Factor=1)
list_item_3 = ListItem(List=sort_by_vector_3.Geometry, Index=0, Wrap=True)
sort_by_vector_4 = SortByVector(Geometry=find_visible_edges_3.Points, Vector=unit_x_8)  # -> Geometry, Indices
list_item_4 = ListItem(List=sort_by_vector_4.Geometry, Index=0, Wrap=True)  # -> Item1, Item
merge_4 = Merge(Data1=list_item_4.Item1, Data2=list_item_3)  # -> flatten(Result)
merge_5 = Merge(
    Data1=find_visible_edges_3.Points,
    Data2=list_item_3,
    Data3=list_item_2.Item,
    Data4=list_item_2.Item1,
    Data5=list_item_2.Item2)  # -> flatten(Result)
front_view_points_direction_1_dimension = RemoteSender(find_visible_edges_3.Points)  # "Front View Points Direction 1 Dimension 2"
front_view_points_direction_1_dimension_2 = RemoteSender(merge_5)  # "Front View Points Direction 1 Dimension 1"
front_view_points_direction_1_dimension_3 = RemoteSender(merge_4)

list_length = ListLength(List=document_info.Components)
list_length_2 = ListLength(List=document_info.Params)
panel_7 = Panel(document_info.DocumentName)
panel_8 = Panel(list_length)
panel_9 = Panel(list_length_2)

# ----
# Top View Points Direction 1
top_view_direction_1_3 = RemoteReceiver(top_view_direction_1_2)
top_view_direction_1_4 = RemoteReceiver(top_view_direction_1_2)
top_view_bolt_points_2 = RemoteReceiver(top_view_bolt_points)
top_view_direction_1_5 = RemoteReceiver(top_view_direction_1_2)
top_view_main_part_union_box_2 = RemoteReceiver(top_view_main_part_union_box)
top_view_secondary_part_union_box_2 = RemoteReceiver(top_view_secondary_part_union_box)
unit_x_9 = UnitX(Factor=1)
find_visible_edges_5 = FindVisibleEdges(Curve=top_view_secondary_part_union_box_2, Vector=top_view_direction_1_4)  # -> Points, Edges, Extremes
sort_by_vector_5 = SortByVector(Geometry=top_view_bolt_points_2, Vector=top_view_direction_1_5)  # -> Geometry, Indices
find_visible_edges_6 = FindVisibleEdges(Curve=top_view_main_part_union_box_2, Vector=top_view_direction_1_3)  # -> Points, Edges, Extremes
sort_by_vector_6 = SortByVector(Geometry=find_visible_edges_5.Points, Vector=unit_x_9)  # -> Geometry, Indices
list_item_5 = ListItem(List=sort_by_vector_5.Geometry, Index=0, Wrap=True)  # -> Item, Item1, Item2
list_item_6 = ListItem(List=sort_by_vector_6.Geometry, Index=0, Wrap=True)
merge_6 = Merge(
    Data1=find_visible_edges_6.Points,
    Data2=list_item_6,
    Data3=list_item_5.Item,
    Data4=list_item_5.Item1,
    Data5=list_item_5.Item2)  # -> flatten(Result)
top_view_points_direction_1 = RemoteSender(merge_6)

# ----
# Top View Points Direction 2
top_view_direction_2_3 = RemoteReceiver(top_view_direction_2_2)
top_view_direction_2_4 = RemoteReceiver(top_view_direction_2_2)
top_view_bolt_points_3 = RemoteReceiver(top_view_bolt_points)
top_view_main_part_union_box_3 = RemoteReceiver(top_view_main_part_union_box)
sort_by_vector_7 = SortByVector(Geometry=top_view_bolt_points_3, Vector=top_view_direction_2_4)  # -> Geometry, Indices
find_visible_edges_7 = FindVisibleEdges(Curve=top_view_main_part_union_box_3, Vector=top_view_direction_2_3)  # -> Points, Edges, Extremes
list_item_7 = ListItem(List=sort_by_vector_7.Geometry, Index=0, Wrap=True)  # -> Item, Item1
merge_7 = Merge(Data1=find_visible_edges_7.Points, Data2=list_item_7.Item, Data3=list_item_7.Item1)  # -> flatten(Result)
top_view_points_direction_2 = RemoteSender(merge_7)

# ----
# Section View Points Direction 1
section_view_direction_1_3 = RemoteReceiver(section_view_direction_1_2)
section_view_bolt_points_2 = RemoteReceiver(section_view_bolt_points)
section_view_direction_1_4 = RemoteReceiver(section_view_direction_1_2)
section_view_direction_1_5 = RemoteReceiver(section_view_direction_1_2)
section_view_main_part_union_box_2 = RemoteReceiver(section_view_main_part_union_box)
section_view_secondary_part_union_box_2 = RemoteReceiver(section_view_secondary_part_union_box)
sort_by_vector_8 = SortByVector(Geometry=section_view_bolt_points_2, Vector=section_view_direction_1_4)  # -> Geometry, Indices
find_visible_edges_8 = FindVisibleEdges(Curve=section_view_main_part_union_box_2, Vector=section_view_direction_1_3)  # -> Points, Edges, Extremes
find_visible_edges_9 = FindVisibleEdges(Curve=section_view_secondary_part_union_box_2, Vector=section_view_direction_1_5)  # -> Points, Edges, Extremes
list_item_8 = ListItem(List=sort_by_vector_8.Geometry, Index=0, Wrap=True)  # -> Item, Item1
merge_8 = Merge(Data1=find_visible_edges_8.Points, Data2=list_item_8.Item, Data3=list_item_8.Item1)  # -> flatten(Result)
section_view_points_direction_1_dimensio = RemoteSender(merge_8)  # "Section View Points Direction 1 Dimension 1"
section_view_points_direction_1_dimensio_2 = RemoteSender(find_visible_edges_9.Extremes)  # "Section View Points Direction 1 Dimension 2"

# ----
# Section View Points Direction 2
section_view_direction_2_3 = RemoteReceiver(section_view_direction_2_2)
section_view_bolt_points_3 = RemoteReceiver(section_view_bolt_points)
section_view_direction_2_4 = RemoteReceiver(section_view_direction_2_2)
section_view_direction_2_5 = RemoteReceiver(section_view_direction_2_2)
section_view_main_part_union_box_3 = RemoteReceiver(section_view_main_part_union_box)
section_view_secondary_part_union_box_3 = RemoteReceiver(section_view_secondary_part_union_box)
sort_by_vector_9 = SortByVector(Geometry=section_view_bolt_points_3, Vector=section_view_direction_2_4)  # -> Geometry, Indices
find_visible_edges_10 = FindVisibleEdges(Curve=section_view_main_part_union_box_3, Vector=section_view_direction_2_3)  # -> Points, Edges, Extremes
find_visible_edges_11 = FindVisibleEdges(Curve=section_view_secondary_part_union_box_3, Vector=section_view_direction_2_5)  # -> Points, Edges, Extremes
list_item_9 = ListItem(List=sort_by_vector_9.Geometry, Index=0, Wrap=True)  # -> Item, Item1
merge_9 = Merge(Data1=find_visible_edges_10.Extremes, Data2=list_item_9.Item, Data3=list_item_9.Item1)  # -> flatten(Result)
section_view_points_direction_2_dimensio = RemoteSender(merge_9)  # "Section View Points Direction 2 Dimension 1"
section_view_points_direction_2_dimensio_2 = RemoteSender(find_visible_edges_11.Extremes)  # "Section View Points Direction 2 Dimension 2"

# ----
# Bottom View Points Direction 1
bottom_view_direction_1_3 = RemoteReceiver(bottom_view_direction_1_2)
bottom_view_bolt_points_2 = RemoteReceiver(bottom_view_bolt_points)
bottom_view_direction_1_4 = RemoteReceiver(bottom_view_direction_1_2)
bottom_view_direction_1_5 = RemoteReceiver(bottom_view_direction_1_2)
bottom_view_main_part_union_box_2 = RemoteReceiver(bottom_view_main_part_union_box)
bottom_view_secondary_part_union_box_2 = RemoteReceiver(bottom_view_secondary_part_union_box)
sort_by_vector_10 = SortByVector(Geometry=bottom_view_bolt_points_2, Vector=bottom_view_direction_1_4)  # -> Geometry, Indices
unit_x_10 = UnitX(Factor=1)
find_visible_edges_12 = FindVisibleEdges(Curve=bottom_view_secondary_part_union_box_2, Vector=bottom_view_direction_1_3)  # -> Points, Edges, Extremes
find_visible_edges_13 = FindVisibleEdges(Curve=bottom_view_main_part_union_box_2, Vector=bottom_view_direction_1_5)  # -> Points, Edges, Extremes
list_item_10 = ListItem(List=sort_by_vector_10.Geometry, Index=0, Wrap=True)  # -> Item, Item1, Item2
sort_by_vector_11 = SortByVector(Geometry=find_visible_edges_12.Points, Vector=unit_x_10)  # -> Geometry, Indices
list_item_11 = ListItem(List=sort_by_vector_11.Geometry, Index=0, Wrap=True)
merge_10 = Merge(
    Data1=find_visible_edges_13.Points,
    Data2=list_item_11,
    Data3=list_item_10.Item,
    Data4=list_item_10.Item1,
    Data5=list_item_10.Item2)  # -> flatten(Result)
bottom_view_points_direction_1 = RemoteSender(merge_10)

# ----
# Bottom View Points Direction 2
bottom_view_direction_2_3 = RemoteReceiver(bottom_view_direction_2_2)
bottom_view_direction_2_4 = RemoteReceiver(bottom_view_direction_2_2)
bottom_view_bolt_points_3 = RemoteReceiver(bottom_view_bolt_points)
bottom_view_main_part_union_box_3 = RemoteReceiver(bottom_view_main_part_union_box)
sort_by_vector_12 = SortByVector(Geometry=bottom_view_bolt_points_3, Vector=bottom_view_direction_2_4)  # -> Geometry, Indices
find_visible_edges_14 = FindVisibleEdges(Curve=bottom_view_main_part_union_box_3, Vector=bottom_view_direction_2_3)  # -> Points, Edges, Extremes
list_item_12 = ListItem(List=sort_by_vector_12.Geometry, Index=0, Wrap=True)  # -> Item, Item1
merge_11 = Merge(Data1=find_visible_edges_14.Points, Data2=list_item_12.Item, Data3=list_item_12.Item1)  # -> flatten(Result)
bottom_view_points_direction_2 = RemoteSender(merge_11)

# ----
# 3d View Drawing Objects For Marks
_3d_view_3 = RemoteReceiver(_3d_view_2)
_3d_view_4 = RemoteReceiver(_3d_view_2)
_3d_view_5 = RemoteReceiver(_3d_view_2)
_3d_view_6 = RemoteReceiver(_3d_view_2)
main_part_5 = RemoteReceiver(main_part)
secondaries_5 = RemoteReceiver(secondaries)
main_part_bolt_array_8 = RemoteReceiver(main_part_bolt_array)
secondary_part_bolt_array_4 = RemoteReceiver(secondary_part_bolt_array)
model_to_drawing_object_7 = ModelToDrawingObject(ViewBase=_3d_view_3, ModelObject=main_part_5)
model_to_drawing_object_8 = ModelToDrawingObject(ViewBase=_3d_view_4, ModelObject=secondaries_5)
graft_tree_4 = GraftTree(Tree=main_part_bolt_array_8, IncludeEmptyLists=True, IncludeNullItems=True)
explode_tree_7 = ExplodeTree(Data=graft_tree_4)  # -> Branch0, Branch1, Branch2
model_to_drawing_object_9 = ModelToDrawingObject(ViewBase=_3d_view_5, ModelObject=[explode_tree_7.Branch1, explode_tree_7.Branch0, explode_tree_7.Branch2])
model_to_drawing_object_10 = ModelToDrawingObject(ViewBase=_3d_view_6, ModelObject=secondary_part_bolt_array_4)
merge_12 = Merge(
    Data1=model_to_drawing_object_7,
    Data2=model_to_drawing_object_8,
    Data3=model_to_drawing_object_9,
    Data4=model_to_drawing_object_10)
_3d_view_drawing_objects = RemoteSender(merge_12)

mark_attributes_7 = RemoteReceiver(mark_attributes_2)
_3d_view_drawing_objects_2 = RemoteReceiver(_3d_view_drawing_objects)
mark_5 = Mark(DrawingObject=_3d_view_drawing_objects_2, Attributes=mark_attributes_7, Remove_when_input_is_empty=False)

# ----
# Front View Location Of Dimension
front_view_direction_1_6 = RemoteReceiver(front_view_direction_1_2)
front_view_union_box_3 = RemoteReceiver(front_view_union_box)
front_view_direction_2_5 = RemoteReceiver(front_view_direction_2_2)
front_view_direction_1_7 = RemoteReceiver(front_view_direction_1_2)
front_view_direction_1_8 = RemoteReceiver(front_view_direction_1_2)
front_view_union_box_4 = RemoteReceiver(front_view_union_box)
front_view_union_box_5 = RemoteReceiver(front_view_union_box)
front_view_direction_2_6 = RemoteReceiver(front_view_direction_2_2)
front_view_dimension_offset_5 = RemoteReceiver(front_view_dimension_offset_4)
front_view_dimension_offset_6 = RemoteReceiver(front_view_dimension_offset_4)
front_view_dimension_offset_3_3 = RemoteReceiver(front_view_dimension_offset_3_2)
front_view_dimension_offset_7 = RemoteReceiver(front_view_dimension_offset_4)
front_view_dimension_offset_2_4 = RemoteReceiver(front_view_dimension_offset_2_2)
entwine = Entwine(Branch00=front_view_direction_1_8, Branch01=front_view_direction_2_5, FlattenInputs=True)
entwine_2 = Entwine(Branch00=front_view_direction_1_7, Branch01=front_view_direction_2_6, FlattenInputs=True)
reverse = Reverse(Vector=entwine_2)
reverse_2 = Reverse(Vector=front_view_direction_1_6)
reverse_3 = Reverse(Vector=entwine)
addition_3 = Addition(A=front_view_dimension_offset_7, B=front_view_dimension_offset_2_4)
addition_4 = Addition(A=front_view_dimension_offset_5, B=front_view_dimension_offset_2_3, C=front_view_dimension_offset_3_3)
find_visible_edges_15 = FindVisibleEdges(Curve=front_view_union_box_5, Vector=front_view_direction_1_6)  # -> Points, Edges, Extremes
find_visible_edges_16 = FindVisibleEdges(Curve=front_view_union_box_4, Vector=entwine)  # -> Points, Edges, Extremes
find_visible_edges_17 = FindVisibleEdges(Curve=front_view_union_box_3, Vector=entwine_2)  # -> Points, Edges, Extremes
multiplication_2 = Multiplication(A=reverse, B=addition_3)
multiplication_3 = Multiplication(A=reverse_2, B=addition_4)
multiplication_4 = Multiplication(A=reverse_3, B=front_view_dimension_offset_6)
move_7 = Move(Geometry=find_visible_edges_16.Edges, Motion=multiplication_4)  # -> Geometry, Transform
move_8 = Move(Geometry=find_visible_edges_17.Edges, Motion=multiplication_2)  # -> Geometry, Transform
move_9 = Move(Geometry=find_visible_edges_15.Edges, Motion=multiplication_3)  # -> Geometry, Transform
front_view_location_of_dimension_1 = RemoteSender(move_7.Geometry)
front_view_location_of_dimension_2 = RemoteSender(move_8.Geometry)
front_view_location_of_dimension_3 = RemoteSender(move_9.Geometry)

# ----
# Section View Location Of Dimension
section_view_union_box_2 = RemoteReceiver(section_view_union_box)
section_view_direction_1_6 = RemoteReceiver(section_view_direction_1_2)
section_view_direction_2_6 = RemoteReceiver(section_view_direction_2_2)
section_view_union_box_3 = RemoteReceiver(section_view_union_box)
section_view_direction_1_7 = RemoteReceiver(section_view_direction_1_2)
section_view_direction_2_7 = RemoteReceiver(section_view_direction_2_2)
section_view_dimension_offset_4 = RemoteReceiver(section_view_dimension_offset_3)
section_view_dimension_offset_5 = RemoteReceiver(section_view_dimension_offset_3)
section_view_dimension_offset_2_3 = RemoteReceiver(section_view_dimension_offset_2_2)
entwine_3 = Entwine(Branch00=section_view_direction_1_6, Branch01=section_view_direction_2_6, FlattenInputs=True)
entwine_4 = Entwine(Branch00=section_view_direction_1_7, Branch01=section_view_direction_2_7, FlattenInputs=True)
reverse_4 = Reverse(Vector=entwine_3)
reverse_5 = Reverse(Vector=entwine_4)
find_visible_edges_18 = FindVisibleEdges(Curve=section_view_union_box_2, Vector=entwine_3)  # -> Points, Edges, Extremes
find_visible_edges_19 = FindVisibleEdges(Curve=section_view_union_box_3, Vector=entwine_4)  # -> Points, Edges, Extremes
addition_5 = Addition(A=section_view_dimension_offset_5, B=section_view_dimension_offset_2_3)
multiplication_5 = Multiplication(A=reverse_4, B=section_view_dimension_offset_4)
multiplication_6 = Multiplication(A=reverse_5, B=addition_5)
move_10 = Move(Geometry=find_visible_edges_18.Edges, Motion=multiplication_5)  # -> Geometry, Transform
move_11 = Move(Geometry=find_visible_edges_19.Edges, Motion=multiplication_6)  # -> Geometry, Transform
section_view_location_of_dimension_1 = RemoteSender(move_10.Geometry)
section_view_location_of_dimension_2 = RemoteSender(move_11.Geometry)

# ----
# Bottom View Location Of Dimension
bottom_view_union_box_2 = RemoteReceiver(bottom_view_union_box)
bottom_view_direction_1_6 = RemoteReceiver(bottom_view_direction_1_2)
bottom_view_direction_2_5 = RemoteReceiver(bottom_view_direction_2_2)
bottom_view_dimension_offset_3 = RemoteReceiver(bottom_view_dimension_offset_2)
entwine_5 = Entwine(Branch00=bottom_view_direction_1_6, Branch01=bottom_view_direction_2_5, FlattenInputs=True)
find_visible_edges_20 = FindVisibleEdges(Curve=bottom_view_union_box_2, Vector=entwine_5)  # -> Points, Edges, Extremes
reverse_6 = Reverse(Vector=entwine_5)
multiplication_7 = Multiplication(A=reverse_6, B=bottom_view_dimension_offset_3)
move_12 = Move(Geometry=find_visible_edges_20.Edges, Motion=multiplication_7)  # -> Geometry, Transform
bottom_view_location_of_dimension = RemoteSender(move_12.Geometry)

# ----
# Top View Location Of Dimension
top_view_union_box_2 = RemoteReceiver(top_view_union_box)
top_view_direction_1_6 = RemoteReceiver(top_view_direction_1_2)
top_view_direction_2_5 = RemoteReceiver(top_view_direction_2_2)
top_view_dimension_offset_3 = RemoteReceiver(top_view_dimension_offset_2)
entwine_6 = Entwine(Branch00=top_view_direction_1_6, Branch01=top_view_direction_2_5, FlattenInputs=True)
reverse_7 = Reverse(Vector=entwine_6)
find_visible_edges_21 = FindVisibleEdges(Curve=top_view_union_box_2, Vector=entwine_6)  # -> Points, Edges, Extremes
multiplication_8 = Multiplication(A=reverse_7, B=top_view_dimension_offset_3)
move_13 = Move(Geometry=find_visible_edges_21.Edges, Motion=multiplication_8)  # -> Geometry, Transform
top_view_location_of_dimension = RemoteSender(move_13.Geometry)

# ----
# Front View Dimensions 1
front_view_11 = RemoteReceiver(front_view)
front_view_location_of_dimension_1_2 = RemoteReceiver(front_view_location_of_dimension_1)
front_view_dimension_line_attributes_2 = RemoteReceiver(front_view_dimension_line_attributes)
front_view_points_direction_2_dimension_3 = RemoteReceiver(front_view_points_direction_2_dimension_2)  # "Front View Points Direction 2 Dimension 1"
front_view_points_direction_1_dimension_4 = RemoteReceiver(front_view_points_direction_1_dimension_2)  # "Front View Points Direction 1 Dimension 1"
entwine_7 = Entwine(
    Branch00=front_view_points_direction_1_dimension_4,
    Branch01=front_view_points_direction_2_dimension_3,
    FlattenInputs=True)
dimension_line = DimensionLine(
    View=front_view_11,
    Points=entwine_7,
    Location=front_view_location_of_dimension_1_2,
    DimensionLineAttributes=front_view_dimension_line_attributes_2,
    Insert_always=0,
    Remove_when_input_is_empty=False)

# ----
# Front View Dimensions 2
front_view_12 = RemoteReceiver(front_view)
front_view_location_of_dimension_2_2 = RemoteReceiver(front_view_location_of_dimension_2)
front_view_dimension_line_attributes_3 = RemoteReceiver(front_view_dimension_line_attributes)
front_view_points_direction_1_dimension_5 = RemoteReceiver(front_view_points_direction_1_dimension)  # "Front View Points Direction 1 Dimension 2"
front_view_points_direction_2_dimension_4 = RemoteReceiver(front_view_points_direction_2_dimension)  # "Front View Points Direction 2 Dimension 2"
entwine_8 = Entwine(
    Branch00=front_view_points_direction_1_dimension_5,
    Branch01=front_view_points_direction_2_dimension_4,
    FlattenInputs=True)
dimension_line_2 = DimensionLine(
    View=front_view_12,
    Points=entwine_8,
    Location=front_view_location_of_dimension_2_2,
    DimensionLineAttributes=front_view_dimension_line_attributes_3,
    Insert_always=0,
    Remove_when_input_is_empty=False)

# ----
# Front View Dimensions 3
front_view_13 = RemoteReceiver(front_view)
front_view_location_of_dimension_3_2 = RemoteReceiver(front_view_location_of_dimension_3)
front_view_dimension_line_attributes_4 = RemoteReceiver(front_view_dimension_line_attributes)
front_view_points_direction_1_dimension_6 = RemoteReceiver(front_view_points_direction_1_dimension_3)  # "Front View Points Direction 1 Dimension 3"
dimension_line_3 = DimensionLine(
    View=front_view_13,
    Points=front_view_points_direction_1_dimension_6,
    Location=front_view_location_of_dimension_3_2,
    DimensionLineAttributes=front_view_dimension_line_attributes_4,
    Insert_always=0,
    Remove_when_input_is_empty=False)

# ----
# Top View Dimension
top_view_5 = RemoteReceiver(top_view_2)
top_view_points_direction_2_2 = RemoteReceiver(top_view_points_direction_2)
top_view_points_direction_1_2 = RemoteReceiver(top_view_points_direction_1)
top_view_location_of_dimension_2 = RemoteReceiver(top_view_location_of_dimension)
top_view_dimension_line_attributes_2 = RemoteReceiver(top_view_dimension_line_attributes)
entwine_9 = Entwine(Branch00=top_view_points_direction_1_2, Branch01=top_view_points_direction_2_2, FlattenInputs=True)
dimension_line_4 = DimensionLine(
    View=top_view_5,
    Points=entwine_9,
    Location=top_view_location_of_dimension_2,
    DimensionLineAttributes=top_view_dimension_line_attributes_2,
    Insert_always=0,
    Remove_when_input_is_empty=False)

# ----
# Section View Dimensions 2
section_view_7 = RemoteReceiver(section_view_3)
section_view_location_of_dimension_2_2 = RemoteReceiver(section_view_location_of_dimension_2)
section_view_dimension_line_attributes_2 = RemoteReceiver(section_view_dimension_line_attributes)
section_view_points_direction_2_dimensio_3 = RemoteReceiver(section_view_points_direction_2_dimensio_2)  # "Section View Points Direction 2 Dimension 2"
section_view_points_direction_1_dimensio_3 = RemoteReceiver(section_view_points_direction_1_dimensio_2)  # "Section View Points Direction 1 Dimension 2"
entwine_10 = Entwine(
    Branch00=section_view_points_direction_1_dimensio_3,
    Branch01=section_view_points_direction_2_dimensio_3,
    FlattenInputs=True)
dimension_line_5 = DimensionLine(
    View=section_view_7,
    Points=entwine_10,
    Location=section_view_location_of_dimension_2_2,
    DimensionLineAttributes=section_view_dimension_line_attributes_2,
    Insert_always=0,
    Remove_when_input_is_empty=False)

# ----
# Section View Dimensions 1
section_view_8 = RemoteReceiver(section_view_3)
section_view_location_of_dimension_1_2 = RemoteReceiver(section_view_location_of_dimension_1)
section_view_dimension_line_attributes_3 = RemoteReceiver(section_view_dimension_line_attributes)
section_view_points_direction_1_dimensio_4 = RemoteReceiver(section_view_points_direction_1_dimensio)  # "Section View Points Direction 1 Dimension 1"
section_view_points_direction_2_dimensio_4 = RemoteReceiver(section_view_points_direction_2_dimensio)  # "Section View Points Direction 2 Dimension 1"
entwine_11 = Entwine(
    Branch00=section_view_points_direction_1_dimensio_4,
    Branch01=section_view_points_direction_2_dimensio_4,
    FlattenInputs=True)
dimension_line_6 = DimensionLine(
    View=section_view_8,
    Points=entwine_11,
    Location=section_view_location_of_dimension_1_2,
    DimensionLineAttributes=section_view_dimension_line_attributes_3,
    Insert_always=0,
    Remove_when_input_is_empty=False)

# ----
# Bottom View Dimension
bottom_view_5 = RemoteReceiver(bottom_view_2)
bottom_view_points_direction_1_2 = RemoteReceiver(bottom_view_points_direction_1)
bottom_view_points_direction_2_2 = RemoteReceiver(bottom_view_points_direction_2)
bottom_view_location_of_dimension_2 = RemoteReceiver(bottom_view_location_of_dimension)
bottom_view_dimension_line_attributes_2 = RemoteReceiver(bottom_view_dimension_line_attributes)
entwine_12 = Entwine(Branch00=bottom_view_points_direction_1_2, Branch01=bottom_view_points_direction_2_2, FlattenInputs=True)
dimension_line_7 = DimensionLine(
    View=bottom_view_5,
    Points=entwine_12,
    Location=bottom_view_location_of_dimension_2,
    DimensionLineAttributes=bottom_view_dimension_line_attributes_2,
    Insert_always=0,
    Remove_when_input_is_empty=False)
