# Grasshopper definition Plate drawing thesis.gh (Grasshopper 1.0.8)
# plug-ins: Heteroptera, Grasshopper-Tekla Link 2025.1.20, Grasshopper-Tekla drawing Link 2.23, Bifocals, MetaHopper, Telepathy, Sheepdog

# This Grasshopper script was developed by Edgar Krõzanovski.
user_interaction = Fence(
    Linetype="Continuous",
    NameHorizontal="Left",
    NamePlacement="Outside",
    NameSize=30,
    NameVertical="Top",
    Pattern="[0,0,0,0]",
    Width=14)
single_part_drawing = Fence(
    Linetype="Continuous",
    NameHorizontal="Left",
    NamePlacement="Outside",
    NameSize=30,
    NameVertical="Top",
    Pattern="[0,0,0,0]",
    Width=14)
geometry = Fence(
    Linetype="Continuous",
    NameHorizontal="Left",
    NamePlacement="Outside",
    NameSize=30,
    NameVertical="Top",
    Pattern="[0,0,0,0]",
    Width=14)
# 1/5
part_view = Fence(
    Linetype="Continuous",
    NameHorizontal="Left",
    NamePlacement="Outside",
    NameSize=30,
    NameVertical="Top",
    Pattern="[0,0,0,0]",
    Width=14)

# ----
# Mark Attributes
# 1.
# Select Plate Component in Tekla Structures
panel = Panel("standard")
mark_attributes = MarkAttributes(AttributesName=panel)
mark_attributes_2 = RemoteSender(mark_attributes)

# ----
# Single Part Drawing Attributes
panel_2 = Panel("standard")
single_part_drawing_attributes = RemoteSender(panel_2)

# ----
# Part View Attributes
panel_3 = Panel("new_FAB-PLATE_Without_Dimensions")
part_view_attributes = RemoteSender(panel_3)

# ----
# Dimension Line Attributes
panel_4 = Panel("standard")
dimension_line_attributes = DimensionLineAttributes(AttributesName=panel_4)
part_view_dimension_line_attributes = RemoteSender(dimension_line_attributes)

# ----
# 5.
# Adjust the offset of dimension lines
part_view_dimension_offset = Slider(20, range=10..50)
part_view_dimension_offset_2 = Slider(20, range=10..50)
part_view_direction_1 = ViewingDirection({"From Bottom": {0,1,0}, "From Top": {0,-1,0}}, selected="From Top")
part_view_direction_2 = ViewingDirection({"From Left": {1,0,0}, "From Right": {-1,0,0}}, selected="From Left")
part_view_offset_dimension_2 = RemoteSender(part_view_dimension_offset_2)
part_view_offset_dimension = RemoteSender(part_view_dimension_offset)
part_view_direction_1_2 = RemoteSender(part_view_direction_1)
part_view_direction_2_2 = RemoteSender(part_view_direction_2)

# ----
# 2.
# Create Single Part Drawing by triggering the Toggle.
create_plate_drawing = BooleanToggle(True)
remote_sender = RemoteSender(create_plate_drawing)

# ----
# Move the existing view outside from the drawing
remote_receiver = RemoteReceiver(remote_sender)
active_drawing = ActiveDrawing(Toggle=remote_receiver)
drawing_size = DrawingSize(Drawing=active_drawing)  # -> Width, Height, Rectangle
unit_x = UnitX(Factor=drawing_size.Width)
views_in_drawing = ViewsInDrawing(Drawing=active_drawing, All_objects=0)
negative = Negative(Value=unit_x)
move_view = MoveView(View=views_in_drawing, Vector=negative)

# ----
# Create drawing
remote_receiver_2 = RemoteReceiver(remote_sender)
single_part_drawing_attributes_2 = RemoteReceiver(single_part_drawing_attributes)
selected_model_objects = SelectedModelObjects(Toggle=remote_receiver_2)
deconstruct_component = DeconstructComponent(Component=selected_model_objects, ExplodeSubComponents=False, OrderCreatedObjects=False, ToleranceMm=0.6)  # -> Name, Description, Attributes, CreatedObjects, InputTypes, Inputs
search_using_key = SearchUsingKey(Values=deconstruct_component.CreatedObjects, Keys=deconstruct_component.CreatedObjects, Search="Plate")
create_w_drawing = CreateWDrawing(Part=search_using_key, AttributesName=single_part_drawing_attributes_2, SheetNumber="1")
open_drawing = OpenDrawing(Drawing=create_w_drawing, Show=True)

# ----
# 3.
# Create new view by triggering the Toggle
create_part_view = BooleanToggle(True)
remote_sender_2 = RemoteSender(create_part_view)

# ----
# Active Drawing
remote_receiver_3 = RemoteReceiver(remote_sender_2)
active_drawing_2 = ActiveDrawing(Toggle=remote_receiver_3)
active_drawing_3 = RemoteSender(active_drawing_2)

# ----
# Model Object
active_drawing_4 = RemoteReceiver(active_drawing_3)
drawing_source = DrawingSource(Drawing=active_drawing_4)
plate = RemoteSender(drawing_source)

# ----
# Center of Drawing
active_drawing_5 = RemoteReceiver(active_drawing_3)
drawing_size_2 = DrawingSize(Drawing=active_drawing_5)  # -> Width, Height, Rectangle
geometry_2 = Geometry(drawing_size_2.Rectangle)
center = Center(Geometry=geometry_2)  # -> Center, Dimension
point = Point(center.Center)
center_of_drawing = RemoteSender(point)

# ----
# 4.
# Adjust the drawing scale. Type number to the panel.
panel_5 = Panel("1")
drawing_scale = RemoteSender(panel_5)

# ----
# Create Part View
drawing_scale_2 = RemoteReceiver(drawing_scale)
active_drawing_6 = RemoteReceiver(active_drawing_3)
center_of_drawing_2 = RemoteReceiver(center_of_drawing)
part_view_attributes_2 = RemoteReceiver(part_view_attributes)
part_view_types = PartViewTypes({"Front": "FrontView", "Top": "TopView", "Back": "BackView", "Bottom": "BottomView", "3d": "_3DView"}, selected="Front")
part_view_2 = PartView(
    Drawing=active_drawing_6,
    Type=part_view_types,
    Point=center_of_drawing_2,
    Scale=drawing_scale_2,
    AttributesName=part_view_attributes_2,
    Attributes_by_macro=False,
    Remove_when_input_is_empty=False)
part_view_3 = RemoteSender(part_view_2)

# ----
# Part View Display CS
part_view_4 = RemoteReceiver(part_view_3)
view_properties = ViewProperties(View=part_view_4)  # -> Type, Name, ViewCS, DisplayCS, RestrictionBox, Scale, Tags
part_view_display_cs = RemoteSender(view_properties.DisplayCS)

# ----
# Plate Brep
plate_2 = RemoteReceiver(plate)
convert_to_brep = ConvertToBrep(TeklaObject=plate_2, SolidType=2, ToleranceMm=0.6)
plate_brep = RemoteSender(convert_to_brep)

# ----
# Plate Bolt Array
plate_3 = RemoteReceiver(plate)
get_children = GetChildren(TeklaObject=plate_3, ToleranceMm=0.6)
search_using_key_2 = SearchUsingKey(Values=get_children, Keys=get_children, Search="Bolt Array")
plate_bolt_array = RemoteSender(search_using_key_2)

# ----
# Part View Drawing Objects For Marks
plate_4 = RemoteReceiver(plate)
part_view_5 = RemoteReceiver(part_view_3)
part_view_6 = RemoteReceiver(part_view_3)
plate_bolt_array_2 = RemoteReceiver(plate_bolt_array)
model_to_drawing_object = ModelToDrawingObject(ViewBase=part_view_6, ModelObject=plate_bolt_array_2)
model_to_drawing_object_2 = ModelToDrawingObject(ViewBase=part_view_5, ModelObject=plate_4)
merge = Merge(Data1=model_to_drawing_object, Data2=model_to_drawing_object_2)
part_view_drawing_objects = RemoteSender(merge)

# ----
# 6.
# Enable the mark component to create marks.
mark_attributes_3 = RemoteReceiver(mark_attributes_2)
part_view_drawing_objects_2 = RemoteReceiver(part_view_drawing_objects)
mark = Mark(DrawingObject=part_view_drawing_objects_2, Attributes=mark_attributes_3, Remove_when_input_is_empty=False)  # disabled

# ----
# 2/5
# Part View Plate Boundary
plate_brep_2 = RemoteReceiver(plate_brep)
part_view_display_cs_2 = RemoteReceiver(part_view_display_cs)
simple_orient = SimpleOrient(Geometry=plate_brep_2, Plane=part_view_display_cs_2)
brep_projection_border = BrepProjectionBorder(Brep=simple_orient)  # -> Boundary, Hole, UnionRectangle
part_view_plate_boundary = RemoteSender(brep_projection_border.Boundary)

# ----
# Part View Bolt Points
plate_bolt_array_3 = RemoteReceiver(plate_bolt_array)
part_view_display_cs_3 = RemoteReceiver(part_view_display_cs)
bolt_properties = BoltProperties(Bolt=plate_bolt_array_3)  # -> Size, Standard, Type, Positions, Direction
simple_orient_2 = SimpleOrient(Geometry=bolt_properties.Positions, Plane=part_view_display_cs_3)
part_view_bolt_points = RemoteSender(simple_orient_2)

document_info = DocumentInfo(AutoUpdate=False, Recursive=False)  # -> DocumentName, DocumentFilePath, Components, Params, _3rdPartyAssemblies
list_length = ListLength(List=document_info.Components)
list_length_2 = ListLength(List=document_info.Params)
panel_6 = Panel(document_info.DocumentName)
panel_7 = Panel(list_length)
panel_8 = Panel(list_length_2)

# ----
# Part View Points Direction 1
part_view_bolt_points_2 = RemoteReceiver(part_view_bolt_points)
part_view_direction_1_3 = RemoteReceiver(part_view_direction_1_2)
part_view_direction_1_4 = RemoteReceiver(part_view_direction_1_2)
# 3/5
part_view_plate_boundary_2 = RemoteReceiver(part_view_plate_boundary)
part_view_plate_boundary_3 = RemoteReceiver(part_view_plate_boundary)
find_visible_edges = FindVisibleEdges(Curve=part_view_plate_boundary_2, Vector=part_view_direction_1_3)  # -> Points, Edges, Extremes
find_visible_edges_2 = FindVisibleEdges(Curve=part_view_plate_boundary_3, Vector=part_view_direction_1_4)  # -> Points, Edges, Extremes
merge_2 = Merge(Data1=find_visible_edges.Points, Data2=part_view_bolt_points_2)  # -> flatten(Result)
part_view_points_direction_1_dimension_1 = RemoteSender(merge_2)
part_view_points_direction_1_dimension_2 = RemoteSender(find_visible_edges_2.Extremes)

# ----
# Part View Points Direction 2
part_view_direction_2_3 = RemoteReceiver(part_view_direction_2_2)
part_view_direction_2_4 = RemoteReceiver(part_view_direction_2_2)
part_view_bolt_points_3 = RemoteReceiver(part_view_bolt_points)
part_view_direction_2_5 = RemoteReceiver(part_view_direction_2_2)
part_view_plate_boundary_4 = RemoteReceiver(part_view_plate_boundary)
part_view_plate_boundary_5 = RemoteReceiver(part_view_plate_boundary)
sort_by_vector = SortByVector(Geometry=part_view_bolt_points_3, Vector=part_view_direction_2_5)  # -> Geometry, Indices
find_visible_edges_3 = FindVisibleEdges(Curve=part_view_plate_boundary_5, Vector=part_view_direction_2_4)  # -> Points, Edges, Extremes
find_visible_edges_4 = FindVisibleEdges(Curve=part_view_plate_boundary_4, Vector=part_view_direction_2_3)  # -> Points, Edges, Extremes
list_item = ListItem(List=sort_by_vector.Geometry, Index=0, Wrap=True)
merge_3 = Merge(Data1=find_visible_edges_3.Points, Data2=list_item)  # -> flatten(Result)
part_view_points_direction_2_dimension_1 = RemoteSender(merge_3)
part_view_points_direction_2_dimension_2 = RemoteSender(find_visible_edges_4.Extremes)

# ----
# Part View Location Of Dimension
part_view_direction_1_5 = RemoteReceiver(part_view_direction_1_2)
part_view_direction_2_6 = RemoteReceiver(part_view_direction_2_2)
part_view_direction_1_6 = RemoteReceiver(part_view_direction_1_2)
part_view_direction_2_7 = RemoteReceiver(part_view_direction_2_2)
# 4/5
part_view_plate_boundary_6 = RemoteReceiver(part_view_plate_boundary)
part_view_plate_boundary_7 = RemoteReceiver(part_view_plate_boundary)
part_view_offset_dimension_3 = RemoteReceiver(part_view_offset_dimension)
part_view_offset_dimension_4 = RemoteReceiver(part_view_offset_dimension)
part_view_offset_dimension_2_2 = RemoteReceiver(part_view_offset_dimension_2)
entwine = Entwine(Branch00=part_view_direction_1_5, Branch01=part_view_direction_2_6, FlattenInputs=True)
entwine_2 = Entwine(Branch00=part_view_direction_1_6, Branch01=part_view_direction_2_7, FlattenInputs=True)
find_visible_edges_5 = FindVisibleEdges(Curve=part_view_plate_boundary_6, Vector=entwine)  # -> Points, Edges, Extremes
reverse = Reverse(Vector=entwine)
find_visible_edges_6 = FindVisibleEdges(Curve=part_view_plate_boundary_7, Vector=entwine_2)  # -> Points, Edges, Extremes
reverse_2 = Reverse(Vector=entwine_2)
addition = Addition(A=part_view_offset_dimension_4, B=part_view_offset_dimension_2_2)
multiplication = Multiplication(A=reverse, B=part_view_offset_dimension_3)
multiplication_2 = Multiplication(A=reverse_2, B=addition)
move = Move(Geometry=find_visible_edges_5.Edges, Motion=multiplication)  # -> Geometry, Transform
move_2 = Move(Geometry=find_visible_edges_6.Edges, Motion=multiplication_2)  # -> Geometry, Transform
part_view_location_of_dimension_1 = RemoteSender(move.Geometry)
part_view_location_of_dimension_2 = RemoteSender(move_2.Geometry)

# ----
# 5/5
# Part View Dimensions 1
part_view_7 = RemoteReceiver(part_view_3)
part_view_location_of_dimension_1_2 = RemoteReceiver(part_view_location_of_dimension_1)
part_view_dimension_line_attributes_2 = RemoteReceiver(part_view_dimension_line_attributes)
part_view_points_direction_1_dimension_1_2 = RemoteReceiver(part_view_points_direction_1_dimension_1)
part_view_points_direction_2_dimension_1_2 = RemoteReceiver(part_view_points_direction_2_dimension_1)
entwine_3 = Entwine(
    Branch00=part_view_points_direction_1_dimension_1_2,
    Branch01=part_view_points_direction_2_dimension_1_2,
    FlattenInputs=True)
dimension_line = DimensionLine(
    View=part_view_7,
    Points=entwine_3,
    Location=part_view_location_of_dimension_1_2,
    DimensionLineAttributes=part_view_dimension_line_attributes_2,
    Insert_always=0,
    Remove_when_input_is_empty=False)

# ----
# Part View Dimensions 2
part_view_8 = RemoteReceiver(part_view_3)
part_view_location_of_dimension_2_2 = RemoteReceiver(part_view_location_of_dimension_2)
part_view_dimension_line_attributes_3 = RemoteReceiver(part_view_dimension_line_attributes)
part_view_points_direction_1_dimension_2_2 = RemoteReceiver(part_view_points_direction_1_dimension_2)
part_view_points_direction_2_dimension_2_2 = RemoteReceiver(part_view_points_direction_2_dimension_2)
entwine_4 = Entwine(
    Branch00=part_view_points_direction_1_dimension_2_2,
    Branch01=part_view_points_direction_2_dimension_2_2,
    FlattenInputs=True)
dimension_line_2 = DimensionLine(
    View=part_view_8,
    Points=entwine_4,
    Location=part_view_location_of_dimension_2_2,
    DimensionLineAttributes=part_view_dimension_line_attributes_3,
    Insert_always=0,
    Remove_when_input_is_empty=False)
